# Dynamo graph Fall17_primitive hut_negative_11.17.dyn (Dynamo 1.3.0.875)

# group: robotic arm parameter
code_block = CodeBlock { name = "PrinterArm"; brand = "ABB"; }
create = MachinaDynamo.Robots.Create(code_block.name, code_block.brand)
code_block_2 = CodeBlock { name = "DO10_14"; pin = 1; digitalPin = true; }
setIOName = MachinaDynamo.Robots.SetIOName(create, code_block_2.name, code_block_2.pin, code_block_2.digitalPin)
code_block_3 = CodeBlock()
# ---------- code_block_3.designscript (10 lines) ----------
travelSpeed = 60;
approachSpeed = 60;
traceSpeed = 60;

travelPrecision = 5;
approachPrecision = 3;
tracePrecision = 1;

attachWaitTime = 2500;
traceWaitTime = 1000;
# ----------------------------------------

# group: tool creation
code_block_4 = CodeBlock { "marker"; }
byCoordinates = Point.ByCoordinates()
byOriginNormal = Plane.ByOriginNormal(origin=byCoordinates)
tool_length = DoubleSlider(326, range=0..360 step 0.1)
number_slider = DoubleSlider(168, range=0..310 step 0.1)
translate = CoordinateSystem.Translate(byCoordinates, tool_length, arg3=number_slider)
byOriginNormal_2 = Plane.ByOriginNormal(origin=translate)
number_slider_2 = DoubleSlider(5, range=0..100 step 0.1)
create_2 = MachinaDynamo.Tools.Create(code_block_4, byOriginNormal, byOriginNormal_2, number_slider_2)

attach = MachinaDynamo.Actions.Attach(create_2)
speedTo = MachinaDynamo.Actions.SpeedTo(code_block_3.travelSpeed)
precisionTo = MachinaDynamo.Actions.PrecisionTo(code_block_3.travelPrecision)
file_path = Filename(".\negative_contour.3dm")
fromPath = FileObject(file_path)  # "File.FromPath"
get_RhinoFile = Interoperability.ReadRhino.OpenRhino3dmModel.Get_RhinoFile(fromPath)
get_RhinoObjects = Interoperability.ReadRhino.RhinoObject.Get_RhinoObjects(get_RhinoFile)
rhino_AllGeometryToDS = Interoperability.ReadRhino.RhinoTranslationToDS.Rhino_AllGeometryToDS(get_RhinoObjects)

# group: foam height
number_slider_3 = DoubleSlider(86, range=0..100 step 0.1)

translate_2 = Geometry.Translate(geometry=rhino_AllGeometryToDS.out1, zTranslation=number_slider_3)
number_slider_4 = DoubleSlider(11, range=0..100 step 0.1)
chop = List.Chop(list=translate_2, lengths=number_slider_4)

# group: inner ring
firstItem = List.FirstItem(chop)

# group: inner brim
firstItem_2 = List.FirstItem(firstItem)
number_slider_5 = DoubleSlider(-10, range=-20..100 step 0.1)
offset = Curve.Offset(curve=firstItem_2, distance=number_slider_5)
number_slider_6 = DoubleSlider(20, range=0..100 step 0.1)
pointsAtEqualSegmentLength = Curve.PointsAtEqualSegmentLength(curve=offset, divisions=number_slider_6)
XAxis = Vector.XAxis()
byOriginNormal_3 = Plane.ByOriginNormal(origin=pointsAtEqualSegmentLength, normal=XAxis)
firstItem_3 = List.FirstItem(byOriginNormal_3)

transformTo = MachinaDynamo.Actions.TransformTo(firstItem_3)
speedTo_2 = MachinaDynamo.Actions.SpeedTo(code_block_3.traceSpeed)
precisionTo_2 = MachinaDynamo.Actions.PrecisionTo(code_block_3.tracePrecision)
code_block_5 = CodeBlock { true; }
writeDigital = MachinaDynamo.Actions.WriteDigital(code_block_2.pin, code_block_5)
transformTo_2 = MachinaDynamo.Actions.TransformTo(byOriginNormal_3)
create_3 = List.Create()  # unwired: arg0, arg1, arg2

# group: inner ring
number_slider_7 = DoubleSlider(180, range=0..260 step 0.1)
pointsAtEqualSegmentLength_2 = Curve.PointsAtEqualSegmentLength(curve=firstItem, divisions=number_slider_7)
firstItem_4 = List.FirstItem(pointsAtEqualSegmentLength_2@L2)
addItemToEnd = List.AddItemToEnd(item=firstItem_4@L1, list=pointsAtEqualSegmentLength_2@L2)

create_4 = List.Create()  # unwired: arg0, arg1
create_5 = List.Create()  # unwired: arg0, arg1

# group: outer ring
lastItem = List.LastItem(chop)
reverse = List.Reverse(lastItem)

# group: outline tolerance offset
number_slider_8 = DoubleSlider(-3, range=-3..100 step 0.1)
offset_2 = Curve.Offset(curve=reverse, distance=number_slider_8)

number_of_truss_lines = DoubleSlider(20, range=0..260 step 0.1)
multiple_number = DoubleSlider(6, range=0..100 step 0.1)
mul = number_of_truss_lines * multiple_number
watch = Watch(mul)
pointsAtEqualSegmentLength_3 = Curve.PointsAtEqualSegmentLength(curve=offset_2, divisions=watch)
pointsAtEqualSegmentLength_4 = Curve.PointsAtEqualSegmentLength(curve=firstItem, divisions=number_of_truss_lines)
combine = List.Combine(create_5, pointsAtEqualSegmentLength_3, pointsAtEqualSegmentLength_4)
firstItem_5 = List.FirstItem(combine@L3)
takeEveryNthItem = List.TakeEveryNthItem(firstItem_5@L2, multiple_number)
lastItem_2 = List.LastItem(combine@L3)
combine_2 = List.Combine(create_4, takeEveryNthItem, lastItem_2)
code_block_6 = CodeBlock(combine_2)
# ---------- code_block_6.designscript (21 lines) ----------
points;

reordered = [Imperative]
{
 newList = {};
 layerNum = 0;
 for (layer in points)
 {
  merged = {};
  pointCount = List.Count(layer[0]);
  irange = 0..(pointCount-1);
  for (i in irange) {
   merged[2 * i] = layer[0][i];
   merged[2 * i + 1] = layer[1][i];
  }
  newList[layerNum] = merged;
  layerNum = layerNum + 1;
 }

 return = newList;
};
# ----------------------------------------
watch_2 = Watch(code_block_6.out1)

# group: outer ring
explode = Geometry.Explode(offset_2)
startPoint = Curve.StartPoint(explode)
flatten = Flatten(startPoint@L2)
firstItem_6 = List.FirstItem(flatten@L2)
addItemToEnd_2 = List.AddItemToEnd(item=firstItem_6@L1, list=flatten@L2)

combine_3 = List.Combine(create_3, addItemToEnd, watch_2, addItemToEnd_2)
flatten_2 = Flatten(combine_3)
XAxis_2 = Vector.XAxis()
byOriginNormal_4 = Plane.ByOriginNormal(origin=flatten_2, normal=XAxis_2)
transformTo_3 = MachinaDynamo.Actions.TransformTo(byOriginNormal_4)
code_block_7 = CodeBlock { false; }
writeDigital_2 = MachinaDynamo.Actions.WriteDigital(code_block_2.pin, code_block_7)
flatten_3 = Flatten(byOriginNormal_4)
lastItem_3 = List.LastItem(flatten_3)
number_slider_9 = DoubleSlider(-250, range=-500..500 step 0.1)
number_slider_10 = DoubleSlider(500, range=0..500 step 0.1)
translate_3 = Geometry.Translate(geometry=lastItem_3, xTranslation=number_slider_9, zTranslation=number_slider_10)
transformTo_4 = MachinaDynamo.Actions.TransformTo(translate_3)
create_6 = List.Create(attach, speedTo, precisionTo, transformTo, speedTo_2, precisionTo_2, writeDigital, transformTo_2, transformTo_3, writeDigital_2, transformTo_4)
flatten_4 = Flatten(create_6)

# group: final adjustment
boolean = BoolSelector(true)
boolean_2 = BoolSelector(false)
exportCode = MachinaDynamo.Programs.ExportCode(setIOName, flatten_4, boolean, boolean_2)

# group: output
file_path_2 = Filename(".\negative_11.17.prg")
writeText = File.WriteText(file_path_2, exportCode)

watch_3 = Watch(combine_3)
